# Requirement set software requirements (R2022b)

## 1 [SO-001] The source code must be traceable
The source code shall be located in a repository so that changes can be tracked and previous versions are accessible.

## 2 [SO-002] The software shall be able to communicate the drone and the central computer
A communications software shall be designed so that the drone can communicate with the central computer wirelessly in order to transfer the collected data by the sensors in the drone and receive the instructions from the computer.

## 3 [SO-003] The software shall be able to process images
A processing pipeline shall be created which takes images as inputs and produce obstacle detections as outputs. The detections shall then be processed into instructions for the drone to execute.

## 4 [SO-004] The software shall complete a control loop fast enough to ensure the reactivity of the drone
In order to ensure the reactivity of the drone, the processing pipeline shall be as lightweight as possible by making use of optimizations and efficient technologies.

### 4.1 [SO-004.1] The programming language shall be of the compiled type
The programming language shall be compiled in order to minimize the latency between a detection and the consequent instruction.