# Requirement set stakeholder requirements (R2022b)

## 1 [ST-001] The system shall be functional before may 2023 (Informational)
According to the project management, the drone shall be able to perform both race phases by May 2023. This will be the end of the INGENIA SE Project and the competition will take place.

## 2 [ST-002] The budget available is 2000€ (Informational)
The total budget for the project is 2000€. This means that the drone shall meet all the stated requirements spending less than this amount of money, including hardware and accessories.

## 3 [ST-003] The drone will fly in an enclosed space inside the university (Informational)
In order to meet the legal constraints, the drone shall fly inside the university area and below a specific height. Also, the space shall be enclosed to ensure the drone stability and avoid severe atmospheric disturbances that could damage the drone because of its light weight.