# Requirement set system requirements (R2022b)

## 1 [SY-001] The drone shall be able to fly in a controlled manner
Prior to complete the two different race phases, the drone should be able to perfectly fly in a controlled manner. This is mandatory so that the drone can be able to precisely avoid obstacles.

### 1.1 [SY-001.1] The drone shall be able to lift its own weight plus the components mounted
To participate in the different races the drone shall fly on its own. In order to achieve this, it has to self-propel, so the motors shall provide with the necessary power to lift its own weight and the components mounted.

### 1.2 [SY-001.2] A remote control system shall be able to manipulate the drone manually
The drone shall respond to a manual remote control system to ensure security. If the automatic control system does not behave as expected, the drone shall be controlled in a manual way.

### 1.3 [SY-001.3] A remote control system shall be able to control the movement of the drone automatically
During the second phase of the race, the drone shall avoid certain obstacles. To do this, it shall have to be controlled automatically by a remote system.

### 1.4 [SY-001.4] A control algorithm shall run onboard the drone
Although the computing and control of the drone shall be done from a remote control unit, there shall exist a control algorithm to be run onboard the drone to ensure short time response in basic tasks.

## 2 [SY-002] The drone shall be able to traverse the race track autonomously as fast as possible
The drone shall be able to
- Fly autonomously
- Follow a predefined path
- Detect and avoid hazardous objects
- Detect obstacles
- Make decisions autonomously based on obstacles
- Do this in a fast manner

### 2.1 [SY-002.1] The battery installed shall be large enough to ensure the competition is completed
The battery system equipped on the drone shall be sufficient to complete each tasks with no need for a recharge. Therefore, the battery capacity shall be sufficiently large and the team shall purchase an extra battery to enable tests on the drone while the battery gets recharged.

### 2.2 [SY-002.2] A central computer shall perform the bulk of the processing
A small control algorithm shall be installed on board to perform basic tasks of the drone, but there shall be a remote central unit with which the drone shall be controlled and the calculations necessary to detect and avoid obstacles made.

## 3 [SY-003] The drone shall detect and avoid obstacles
In the second stage of the competition, the drone will need to be able to avoid obstacles of the following categories:
- Hoops
- Poles
- Doors
- Split Rectangles
Therefore, the drone shall be able to distinguish between obstacle types and decide its trajectory based on this information.

### 3.1 [SY-003.1] The drone shall detect obstacles using a mounted camera
A camera shall be used to collect information about the surroundings of the drone. Specifically, information about object types, distance, angles, etc. shall be collected.

### 3.2 [SY-003.2] The images captured by the drone shall be sent to a central computer for processing
The information captured by the camera shall be sent to a central computing unit for processing, detection of substantial information, and decision based on the images captured. This shall be done wirelessly.

### 3.3 [SY-003.3] The drone must react in time to obstacles in its way
The complete process of capturing, sending, processing, receiving and reacting shall be performed sufficiently fast so that the drone shall not collide with obstacles in its way.